test file "controllerTest"

suite "No Charge"

  case "No Charge - 1" [baseline]
    description: State = no charge
      AccPedal = exponential growth and decay over time
      BrakePedal = 0
      SOC = between 0 and 0.1
      Only the IC engine shall be commanded.
    model controllerModel
    input "controllerInputs10.mat", mapped to state, AccPedal, BrakePedal, SOC (active)
    logged signals "Signal Set 1": ICreq
    assessment "Assessment1": At any point of time, ICreq <= AccPedal | ICreq <= 1 must be true
    assessment "Assessment2": At any point of time, MGUreq == 0 must be true
      ICreq: signal controllerModel/TrqDemController, port 1
      AccPedal: signal controllerModel/AccPedal, port 1
      MGUreq: signal controllerModel/TrqDemController, port 2

suite "Dead"
  description: Dead case suite of tests

  case "Dead - 1" [baseline]
    description: State = dead
      AccPedal = exp growth and decay
      BrakePedal = 0
      SOC = from 0.1 to 0
      In dead state, both ICreq and MGUreq shall be zero
    model controllerModel
    input "controllerInputs9.mat", mapped to state, AccPedal, BrakePedal, SOC (active)
    logged signals "Signal Set 1": ICreq, MGUreq, IC_MGU
    baseline "Dead_baseline.mat": abs tol 1e-06, rel tol 1e-06
      IC_MGU
      ICreq
      MGUreq
      ICreq
      IC
      MGU
      MGUreq
      MGUbrk
      FrontBrake
      MGUbrk+Brake

suite "Combined"
  description: Combined case suite of tests

  case "Combined 1" [baseline]
    description: Scenario 1:
      State = combined
      AccPedal = pulse signal of amplitude 0.5, width 0.5 and period 10 seconds
      BrakePedal = 0
      SOC = 50%
    model controllerModel
    input "controllerInputs1.mat", mapped to state, AccPedal, BrakePedal, SOC (active)
    logged signals "Signal Set 1": IC_MGU
    baseline "Combined_Baseline1.mat": abs tol 1e-05, leading tol 0.001, lagging tol 0.001
      IC_MGU: abs tol 1e-05, rel tol 0.001, leading tol 0.001, lagging tol 0.001

  case "Combined 2" [baseline]
    description: Scenario 2:
      State = combined
      AccPedal = pulse signal of amplitude 0.1, width 0.5 and period 10 seconds
      BrakePedal = 0
      SOC = 50%
    model controllerModel
    input "controllerInputs2.mat", mapped to state, AccPedal, BrakePedal, SOC (active)
    logged signals "Signal Set 1": IC_MGU
    baseline "Combined_Baseline2.mat": abs tol 1e-05, leading tol 0.001, lagging tol 0.001
      IC_MGU

  case "Combined 3" [baseline]
    description: Scenario 3:
      State = combined
      AccPedal = pulse signal of amplitude 0.9, width 0.5 and period 10 seconds
      BrakePedal = 0
      SOC = 50%
    model controllerModel
    input "controllerInputs3.mat", mapped to state, AccPedal, BrakePedal, SOC (active)
    logged signals "Signal Set 1": IC_MGU
    baseline "Combined_Baseline3.mat": abs tol 1e-05, leading tol 0.001, lagging tol 0.001
      IC_MGU

  case "Combined 4" [baseline]
    description: Scenario 4:
      State = combined
      AccPedal = exponential growth and decay over time
      BrakePedal = 0
      SOC = 50%
    model controllerModel
    input "controllerInputs4.mat", mapped to state, AccPedal, BrakePedal, SOC (active)
    logged signals "Signal Set 1": IC_MGU
    baseline "Combined_Baseline4.mat": abs tol 1e-05, leading tol 0.001, lagging tol 0.001
      IC_MGU

suite "Regenerative Braking"
  description: Regenerative Braking case suite of tests

  case "Regen 1" [baseline]
    description: Scenario 1:
      State = regenerative braking
      AccPedal = 0
      BrakePedal = pulse signal of amplitude 0.5, width 0.5 and period 10 seconds.
      SOC = 50%
    model controllerModel
    input "controllerInputs5.mat", mapped to state, AccPedal, BrakePedal, SOC (active)
    logged signals "Signal Set 1": MGUbrk+Brake
    baseline "Regen_Baseline1.mat": abs tol 1e-05, leading tol 0.001, lagging tol 0.001
      MGUbrk+Brake

  case "Regen 2" [baseline]
    description: Scenario 2:
      State = regenerative braking
      AccPedal = 0
      BrakePedal = pulse signal of amplitude 0.1, width 0.5 and period 10 seconds.
      SOC = 50%
    model controllerModel
    input "controllerInputs6.mat", mapped to state, AccPedal, BrakePedal, SOC (active)
    logged signals "Signal Set 1": MGUbrk+Brake
    baseline "Regen_Baseline2.mat": abs tol 1e-05, leading tol 0.001, lagging tol 0.001
      MGUbrk+Brake

  case "Regen 3" [baseline]
    description: Scenario 3:
      State = regenerative braking
      AccPedal = 0
      BrakePedal = pulse signal of amplitude 0.9, width 0.5 and period 10 seconds.
      SOC = 100%
    model controllerModel
    input "controllerInputs7.mat", mapped to state, AccPedal, BrakePedal, SOC (active)
    logged signals "Signal Set 1": MGUbrk+Brake
    baseline "Regen_Baseline3.mat": abs tol 1e-05, leading tol 0.001, lagging tol 0.001
      MGUbrk+Brake
    assessment "Assessment1": At any point of time, MGUbrk == 0 must be true
      MGUbrk: signal controllerModel/Gain1, port 1

  case "Regen 4" [baseline]
    description: Scenario 4:
      State = regenerative braking
      AccPedal = 0
      BrakePedal = exponential growth and decay over time
      SOC = 50%
    model controllerModel
    input "controllerInputs8.mat", mapped to state, AccPedal, BrakePedal, SOC (active)
    logged signals "Signal Set 1": MGUbrk+Brake
    baseline "Regen_Baseline4.mat": abs tol 1e-05, leading tol 0.001, lagging tol 0.001
      MGUbrk+Brake

suite "Electrical Drive"
  description: Electrical Drive case suite of tests

  case "ED 1" [baseline]
    description: state = electrical drive
      AccPedal = exponential growth and decay
      BrakePedal = 0
      SOC = from 70% to 15%
      Here, ICreq shall be zero
    model controllerModel
    input "controllerInputs11.mat", mapped to state, AccPedal, BrakePedal, SOC (active)
    logged signals "Signal Set 1": MGUreq, ICreq, MGUbrk+Brake, SOC
    assessment "Assessment1": At any point of time, SOC >= 15 & BrakePedal == 0 & (MGUreq <= AccPedal | MGUreq <= 1) must be true
    assessment "Assessment2": At any point of time, ICreq == 0 must be true
      SOC: signal controllerModel/SOC, port 1
      BrakePedal: signal controllerModel/BrakePedal, port 1
      MGUreq: signal controllerModel/TrqDemController, port 2
      AccPedal: signal controllerModel/AccPedal, port 1
      ICreq: signal controllerModel/TrqDemController, port 1