test file "FSM_test"

suite "DEAD"
  description: This suite contains all the test performed with DEAD as main state. It includes also the transitions from dead to other states.

  case "Dead 1" [baseline]
    description: DEAD state check:
      -no SOC
      -no fuel
      -Uniformely increasing acceleration request
      -zero brake request
      The state should be DEAD for all the testing time.
    model FSM_Model
    input "Dead1.mat", mapped to realSpeed, Fuel, SOC, AccPedal, BrakePedal (active)
    baseline "Dead1.mat"
      state:1

  case "Dead 2" [baseline]
    description: DEAD to Regen state transition check:
      -fuel < fuelMin
      -SOC< SOCMin
      -BrakePedal request at 5s
    model FSM_Model
    input "Dead2.mat", mapped to realSpeed, Fuel, SOC, AccPedal, BrakePedal (active)
    baseline "Dead2_baseline.mat"
      state:1

  case "Dead 3" [baseline]
    description: DEAD to ED state transition check:
      -SOC > SOCMin
      -AccPedal < maxAccMGU
      The state should pass from DEAD to Electric Drive
    model FSM_Model
    input "Dead3.mat", mapped to realSpeed, Fuel, SOC, AccPedal, BrakePedal (active)
    baseline "Dead3_baseline.mat"
      state:1

  case "StrangeCase" [baseline]
    description: No transition due to T>Ted && fuel < fuelMin.
      Possible solution: remove T<Ted in transition from Dead to ED
    model FSM_Model
    input "StrangeCase.mat", mapped to realSpeed, Fuel, SOC, AccPedal, BrakePedal (active)

  case "Dead 4" [baseline]
    description: DEAD to No Charge state transition check:
      -SOC < SOCMin
      -fuel > fuelMin
      -AccPedal < maxAccICE
      The state should pass from DEAD to No Charge
    model FSM_Model
    input "Dead4.mat", mapped to realSpeed, Fuel, SOC, AccPedal, BrakePedal (active)
    baseline "Dead4_baseline.mat"
      state:1

  case "Dead 5" [baseline]
    description: DEAD to Combined state transition check:
      -SOC > SOCMin
      -fuel > fuelMin
      -AccPedal>maxAccMGU
      The state should pass from DEAD to Combined
    model FSM_Model
    input "Dead5.mat", mapped to realSpeed, Fuel, SOC, AccPedal, BrakePedal (active)
    baseline "Dead5_baseline.mat"
      state:1

suite "No Charge"
  description: From No Charge to all other states. Initially, the FSM starts from DEAD, but soon enters the No Charge state at the first sampling instant.

  case "NoCharge-DEAD" [baseline]
    description: Transition from No Charge to DEAD:
      Fuel < fuelMin
      SOC < SOCmin
    model FSM_Model
    input "NoCharge1.mat", mapped to realSpeed, Fuel, SOC, AccPedal, BrakePedal (active)
    baseline "NoChargeToDEAD_baseline.mat"
      state:1

  case "NoCharge-Regen" [baseline]
    description: Transition from No Charge to Regenerative Braking:
      Fuel > fuelMin
      SOC < SOCmin
      BrakePedal request after 5s
    model FSM_Model
    input "NoCharge2.mat", mapped to realSpeed, Fuel, SOC, AccPedal, BrakePedal (active)
    baseline "NoChargeToRegen_baseline.mat"
      state:1

  case "NoCharge-ED" [baseline]
    description: Transition from No Charge to Regenerative Braking:
      Fuel > fuelMin
      SOC < SOCmin for a while, then SOC>SOCmin
      RealSpeed<SpeedEDMax or Fuel<fuelMin after a while
      This check is done in two iterations
    model FSM_Model
    input "NoCharge3.mat", mapped to realSpeed, Fuel, SOC, AccPedal, BrakePedal (active)
    input "NoCharge4.mat", mapped to realSpeed, Fuel, SOC, AccPedal, BrakePedal
    baseline "Iteration1.mat"
      state:1
    baseline "Iteration2.mat"
      state:1
    iterations:
      Iteration1: ExternalInput "NoCharge3.mat", Baseline "Iteration1.mat"
      Iteration2: ExternalInput "NoCharge4.mat", Baseline "Iteration2.mat"

  case "NoCharge-Combined" [baseline]
    description: Transition from No Charge to Combined:
      Fuel > fuelMin
      SOC > SOCmin
      AccPedal> MaxAccICE
    model FSM_Model
    input "NoCharge5.mat", mapped to realSpeed, Fuel, SOC, AccPedal, BrakePedal (active)
    baseline "NoChargeToCombined_baseline.mat"
      state:1