test file "IntegrationTest"

suite "New Test Suite 1"

  case "Test Case 1" [simulation]
    description: Test Case 1:
      -Low speed
      -SOC > SOCMin
      -Fuel > fuelMin
      -AccPedal request at 5s: < MaxAccMGU
      -BrakePedal = 0
      Only MGUdem is expected to be different from zero
    model ControllerModel
    input "Scenario1.mat", mapped to AccPedal, BrakePedal, fuelLevel, SOC, realSpeed (active)
    assessment "Assessment1": At any point of time, if AccPedal > 0 becomes true then, with a delay of at most 0.4, MGUdem > 0 & ICEdem ==0 & Brake == 0 must be true
      AccPedal: signal ControllerModel/AccPedal, port 1
      MGUdem: signal ControllerModel/Controller, port 3
      ICEdem: signal ControllerModel/Controller, port 1
      Brake: signal ControllerModel/Controller, port 2

  case "Test Case 2" [simulation]
    description: Test Case 2:
      -Low speed
      -SOC <SOCMin
      -Fuel > fuelMin
      -AccPedal request at 5s: < MaxAccMGU
      -BrakePedal = 0
      Only ICEdem is expected to be different from zero
    model ControllerModel
    input "Scenario2.mat", mapped to AccPedal, BrakePedal, fuelLevel, SOC, realSpeed (active)
    assessment "Assessment1": At any point of time, if AccPedal > 0 becomes true then, with a delay of at most 0.4, ICEdem > 0 & Brake == 0 & MGUdem == 0 must be true
      AccPedal: signal ControllerModel/AccPedal, port 1
      ICEdem: signal ControllerModel/Controller, port 1
      Brake: signal ControllerModel/Controller, port 2
      MGUdem: signal ControllerModel/Controller, port 3

  case "Test Case 3" [simulation]
    description: Test Case 3:
      -Low speed
      -SOC >SOCMin
      -Fuel < fuelMin
      -AccPedal request at 5s: > MaxAccMGU
      -BrakePedal = 0
      Only MGUdem is expected to be different from zero and to be maximum.
    model ControllerModel
    input "Scenario3.mat", mapped to AccPedal, BrakePedal, fuelLevel, SOC, realSpeed (active)
    assessment "Assessment1": At any point of time, if AccPedal > 0 becomes true then, with a delay of at most 0.4, ICEdem == 0 & MGUdem == 1 & Brake == 0 must be true
      AccPedal: signal ControllerModel/AccPedal, port 1
      ICEdem: signal ControllerModel/Controller, port 1
      MGUdem: signal ControllerModel/Controller, port 3
      Brake: signal ControllerModel/Controller, port 2

  case "Test Case 4" [simulation]
    description: Test Case 4:
      -Low speed
      -SOC < SOCMin
      -Fuel > fuelMin
      -AccPedal request at 5s: > MaxAccICE
      -BrakePedal = 0
      Only ICEdem is expected to be different from zero and to be maximum.
    model ControllerModel
    input "Scenario4.mat", mapped to AccPedal, BrakePedal, fuelLevel, SOC, realSpeed (active)
    assessment "Assessment1": At any point of time, if AccPedal > 0 becomes true then, with a delay of at most 0.4, ICEdem == 1 & MGUdem == 0 & Brake == 0 must be true
      AccPedal: signal ControllerModel/AccPedal, port 1
      ICEdem: signal ControllerModel/Controller, port 1
      MGUdem: signal ControllerModel/Controller, port 3
      Brake: signal ControllerModel/Controller, port 2

  case "Test Case 5" [simulation]
    description: Test Case 5:
      -High speed
      -SOC > SOCMin
      -Fuel > fuelMin
      -AccPedal request until 5s: AccPedal > MaxAccMGU
      -BrakePedal request after 5s
    model ControllerModel
    input "Scenario5.mat", mapped to AccPedal, BrakePedal, fuelLevel, SOC, realSpeed (active)
    assessment "Assessment1": At any point of time, whenever AccPedal > 0 is true then, with a delay of at most 0.2, ICEdem > 0 & MGUdem > 0 & Brake == 0 must be true
    assessment "Assessment2": At any point of time, whenever BrakePedal > 0 is true then, with a delay of at most 0.4, MGUdem < 0 & ICEdem == 0 & Brake > 0 must be true
      AccPedal: signal ControllerModel/AccPedal, port 1
      ICEdem: signal ControllerModel/Controller, port 1
      MGUdem: signal ControllerModel/Controller, port 3
      Brake: signal ControllerModel/Controller, port 2
      BrakePedal: signal ControllerModel/BrakePedal, port 1

  case "Test Case 6" [simulation]
    description: Test Case 6:
      -Low Speed
      -SOC < SOCMin
      -Fuel < fuelMin
      -AccPedal request until 5s
      -BrakePedal after 5s
      ICEdem == MGUdem == 0. Brake == 0 until 5s then Brake>0 and MGUdem<0
    model ControllerModel
    input "Scenario6.mat", mapped to AccPedal, BrakePedal, fuelLevel, SOC, realSpeed (active)
    assessment "Assessment1": At any point of time, whenever AccPedal > 0 is true then, with no delay, ICEdem == 0 & MGUdem == 0 & Brake == 0 must be true
    assessment "Assessment2": At any point of time, whenever BrakePedal > 0 is true then, with a delay of at most 0.25, Brake > 0 must be true
    assessment "Assessment3": At any point of time, whenever BrakePedal > 0 is true then, with a delay of at most 0.4, MGUdem < 0 & MGUdem < 1 must be true
      AccPedal: signal ControllerModel/AccPedal, port 1
      ICEdem: signal ControllerModel/Controller, port 1
      MGUdem: signal ControllerModel/Controller, port 3
      Brake: signal ControllerModel/Controller, port 2
      BrakePedal: signal ControllerModel/BrakePedal, port 1

  case "Test Case 7" [simulation]
    description: Test Case 7:
      -Speed uniformely increasing up to above the MaxSpeedMGU
      -SOC >SOCMin
      -Fuel > fuelMin
      -AccPedal request
    model ControllerModel
    input "Scenario7.mat", mapped to AccPedal, BrakePedal, fuelLevel, SOC, realSpeed (active)
    assessment "Assessment1": At any point of time, whenever RealSpeed > 30 is true then, with a delay of at most 0.4, ICEdem > 0 must be true
    assessment "Assessment2": At any point of time, whenever AccPedal > 0 & RealSpeed > 30 is true then, with a delay of at most 0.2, MGUdem > 0 & ICEdem >  0 must be true
      RealSpeed: signal ControllerModel/realSpeed, port 1
      ICEdem: signal ControllerModel/Controller, port 1
      AccPedal: signal ControllerModel/AccPedal, port 1
      MGUdem: signal ControllerModel/Controller, port 3

  case "Test Case 8" [simulation]
    description: Test Case 7:
      -Low Speed
      -SOC<SOCMin until 7s
      -Fuel > fuelMin
      -AccPedal request up to 5s and between 7s and 10s
      -BrakePedal request between 5 and 7s
    model ControllerModel
    input "Scenario8.mat", mapped to AccPedal, BrakePedal, fuelLevel, SOC, realSpeed (active)
    assessment "Assessment1": At any point of time, whenever SOC > 15 & AccPedal > 0 is true then, with a delay of at most 0.4, MGUdem > 0 must be true
      SOC: signal ControllerModel/SOC, port 1
      AccPedal: signal ControllerModel/AccPedal, port 1
      MGUdem: signal ControllerModel/Controller, port 3